# Dynamo custom node String.ByRevitLanguageType.dyf (Dynamo 1.3.2.2480)
# category: EnjoyBIM
# Depending on the active Revit Language, the suitable input is used.

EnglishParameterName_ENU = Input(EnglishParameterName_ENU : string)  # English (USA or GB).
GermanParameterName_DEU = Input(GermanParameterName_DEU : string)  # German.
SpanishParameterName_ESP = Input(SpanishParameterName_ESP : string)  # Spanish.
FrenshParameterName_FRA = Input(FrenshParameterName_FRA : string)  # Frensh.
ItalianParameterName_ITA = Input(ItalianParameterName_ITA : string)  # Italian.
ChineseSimplifiedParameterName_CHS = Input(ChineseSimplifiedParameterName_CHS : string)  # Chinese Simplified.
ChineseTraditionalParameterName_CHT = Input(ChineseTraditionalParameterName_CHT : string)  # Chinese Traditional.
JapaneseParameterName_JPN = Input(JapaneseParameterName_JPN : string)  # Japanese.
KoreanParameterName_KOR = Input(KoreanParameterName_KOR : string)  # Korean.
RussianParameterName_RUS = Input(RussianParameterName_RUS : string)  # Russian.
CzechParameterName_CSK = Input(CzechParameterName_CSK : string)  # Czech.
PortugueseParameterName_PTB = Input(PortugueseParameterName_PTB : string)  # Brazilian Portuguese.
PolishParameterName_PLK = Input(PolishParameterName_PLK : string)  # Polish.
python_script = Python(IN[0]=EnglishParameterName_ENU, IN[1]=GermanParameterName_DEU, IN[2]=SpanishParameterName_ESP, IN[3]=FrenshParameterName_FRA, IN[4]=ItalianParameterName_ITA, IN[5]=ChineseSimplifiedParameterName_CHS, IN[6]=ChineseTraditionalParameterName_CHT, IN[7]=JapaneseParameterName_JPN, IN[8]=KoreanParameterName_KOR, IN[9]=RussianParameterName_RUS, IN[10]=CzechParameterName_CSK, IN[11]=PortugueseParameterName_PTB, IN[12]=PolishParameterName_PLK)
# ---------- python_script.python (62 lines) ----------
import clr

# Import DocumentManager
clr.AddReference("RevitServices")
import RevitServices
from RevitServices.Persistence import DocumentManager

clr.AddReference("RevitAPI")
import Autodesk
from Autodesk.Revit.DB import *

uiapp = DocumentManager.Instance.CurrentUIApplication
app = uiapp.Application

languageENU=IN[0]
languageDEU=IN[1]
languageESP=IN[2]
languageFRA=IN[3]
languageITA=IN[4]
languageCHS=IN[5]
languageCHT=IN[6]
languageJPN=IN[7]
languageKOR=IN[8]
languageRUS=IN[9]
languageCSY=IN[10]
languagePLK=IN[11]
languagePTB=IN[12]


##  CODE to check the language from REVIT ###
Revitlanguage = app.Language
	if Revitlanguage == Autodesk.Revit.ApplicationServices.LanguageType.English_USA:
		result = languageENU
	elif Revitlanguage == Autodesk.Revit.ApplicationServices.LanguageType.German:
		result = languageDEU
	elif Revitlanguage == Autodesk.Revit.ApplicationServices.LanguageType.Spanish:
		result = languageESP
	elif Revitlanguage == Autodesk.Revit.ApplicationServices.LanguageType.French:
		result = languageFRA
	elif Revitlanguage == Autodesk.Revit.ApplicationServices.LanguageType.Italian:
		result = languageITA
	elif Revitlanguage == Autodesk.Revit.ApplicationServices.LanguageType.Chinese_Simplified:
		result = languageCHS
	elif Revitlanguage == Autodesk.Revit.ApplicationServices.LanguageType.Chinese_Traditional:
		result = languageCHT
	elif Revitlanguage == Autodesk.Revit.ApplicationServices.LanguageType.Japanese:
		result = languageJPN
	elif Revitlanguage == Autodesk.Revit.ApplicationServices.LanguageType.Korean:
		result = languageKOR
	elif Revitlanguage == Autodesk.Revit.ApplicationServices.LanguageType.Russian:
		result = languageRUS
	elif Revitlanguage == Autodesk.Revit.ApplicationServices.LanguageType.Czech:
		result = languageCSY
	elif Revitlanguage == Autodesk.Revit.ApplicationServices.LanguageType.Polish:
		result = languagePLK
	elif Revitlanguage == Autodesk.Revit.ApplicationServices.LanguageType.Brazilian_Portuguese:
		result = languagePTB
	else 
		result = boom


OUT=result
# ----------------------------------------
ParameterNameByLanguage = Output(python_script)
